# Grasshopper definition AAG_Prapawit_CNC_Source.gh (Grasshopper 1.0.7)
# plug-ins: Kangaroo2 Components, Ovenbird 2, PolyFrame 2

domain_box = DomainBox(Base=PlaneXY(0, 0, 0), X=Slider(40, range=0..100), Y=Slider(40, range=0..100), Z=Slider(45, range=0..100))
populate_geometry = PopulateGeometry(Geometry=domain_box, Count=Slider(9, range=1..20), Seed=Slider(8, range=1..12))
brep_edges = BrepEdges(Brep=domain_box)  # -> Naked, Interior, NonManifold
voronoi_3d = Voronoi3D(Points=populate_geometry, Box=domain_box)  # -> Cells, Boundary
deconstruct_brep = DeconstructBrep(Brep=voronoi_3d.Cells)  # -> Faces, Edges, Vertices
volume = Volume(Geometry=graft(voronoi_3d.Cells))  # -> Volume, Centroid
polygon_center = PolygonCenter(Polyline=deconstruct_brep.Faces)  # -> CenterV, CenterE, CenterA
number_slider = Slider(3.16, range=0..10)
number_slider_2 = Slider(1, range=0..1)
number_slider_3 = Slider(0.62, range=0..10)
line = Line(StartPoint=volume.Centroid, EndPoint=polygon_center.CenterV)  # -> flatten(Line)
multipipe = MultiPipe(
    Curves=line,
    NodeSize=Slider(3.16, range=0..10),
    EndOffset=Slider(1, range=0..1),
    StrutSize=Slider(0.62, range=0..10),
    Segment=0,
    KinkAngle=0.6,
    CubeFit=0,
    Caps=2)
brep = Brep(multipipe)
brep_2 = Brep(multipipe)
brep_3 = Brep(brep_2)
colour_swatch = ColourSwatch(SwatchColor=RGB(255, 0, 115))  # disabled
meshoverhang = MeshOverhang(Mesh=brep_3, Interval=Domain(0, 1.5), paletteI=0, useSmooth=True, useVertex=True)  # -> Mesh, OverhangDistribution
subd_edges = SubDEdges(SubD=multipipe, NewFormatting=False)  # -> Line, Edge, Tag, Id
# 1: You can change the height of the nozzle to create Continuous Toolpaths accordingly.
number_slider_4 = Slider(2, range=0..10)
# 1: Toolpath Topology solver divides a branching/porous geometry into islands.
number_slider_5 = Slider(2, range=0..10)
custom_preview = CustomPreview(Geometry=simplify(multipipe), Material=colour_swatch)
examplefiles = ExampleFiles()
examplefiles_2 = ExampleFiles()  # disabled
geometry = Geometry(brep_3)
geometry_2 = Geometry(brep_2)
curve = Curve(subd_edges.Edge)
cnc_source = Geometry(multipipe)
slice = Slice(Geometry=flatten(geometry), Thickness=number_slider_4, joinCurves=True, useBoundingBed=False)
slice_2 = Slice(Geometry=flatten(geometry_2), Thickness=number_slider_5, joinCurves=True, useBoundingBed=False)
examplefiles_3 = ExampleFiles()

# ----
# 6 1/2 Layer-Level Optimizations
# 1: Change the clearance to see the effect of Overfill Optimizaton.
# 3: Mesh visualization shows how this reduces the overfill.
# 2: Overfill Optimization creates clearance between parallel curve segments that are too close to each other.
number_slider_6 = Slider(1.5, range=0..10)  # disabled
geo = Geometry(brep)  # disabled
number_slider_7 = Slider(4, range=0..10)  # disabled
slice_3 = Slice(Geometry=flatten(geo), Thickness=number_slider_6, joinCurves=True, useBoundingBed=False)  # disabled
number_slider_8 = Slider(8, range=0..100)  # disabled
polylinetp = PolylineToolpath(Toolpath=slice_3, polylineType=0)  # disabled
swatch = ColourSwatch(SwatchColor=RGB(255, 0, 0))  # disabled
inspecttp = InspectToolpath(Toolpath=polylinetp, Angle=degrees(0), Columns=5, Spacing=number_slider_8)  # -> Curves, Planes; disabled
overfilloptimization = OverfillOptimization(Toolpath=polylinetp, Strength=0.2, Times=5, Clearance=number_slider_7)  # disabled
preview = CustomPreview(Geometry=inspecttp.Curves, Material=swatch)  # disabled
smoothtp = SmoothToolpath(Toolpath=overfilloptimization, Strength=1, Times=100, side=1)  # disabled
inspecttp_2 = InspectToolpath(Toolpath=smoothtp, Angle=degrees(0), Columns=5, Planes=inspecttp.Planes)  # -> Curves, Planes; disabled
swatch_2 = ColourSwatch(SwatchColor=RGB(25, 255, 0))  # disabled
preview_2 = CustomPreview(Geometry=inspecttp_2.Curves, Material=swatch_2)  # disabled
visualizeprinting = VisualizePrinting(Toolpath=smoothtp, Width=number_slider_7, Sides=3, mergeEnds=True, useSegmentWidth=False)  # disabled
tpplanes = ToolpathPlanes(Toolpath=smoothtp)  # -> BasePlane, SlicePlanes, NozzlePlanes; disabled
orient = Orient(Geometry=visualizeprinting, Source=tpplanes.SlicePlanes, Target=inspecttp_2.Planes)  # -> Geometry, Transform; disabled

movetp = MoveToolpath(Toolpath=slice, Vector=Vector(150, 0, 0))  # -> Toolpath, Transform
cleantp = CleanToolpath(Toolpath=movetp.Toolpath, closeOpen=True, cullShort=True)  # -> Toolpath, Curves
tpregions = ToolpathRegions(Toolpath=cleantp.Toolpath)
localoverhang = LocalOverhang(Toolpath=cleantp.Toolpath, Interval=Domain(0, 1.5), paletteI=0, useLayer=False, useSmooth=True)
globaloverhang = GlobalOverhang(Toolpath=cleantp.Toolpath, Interval=Domain(0, 5), paletteI=0, useSmooth=True)
cleantp_2 = CleanToolpath(Toolpath=movetp.Toolpath, closeOpen=True, cullShort=True)  # -> Toolpath, Curves

# ----
# 6 1/2 Layer-Level Optimizations
# 4: By Simplify Toolpath and Merge Toolpath, the number of toolpath curves per layer is reduced. This helps the making of the Continuous Toolpath.
# 5: If a negative Distance is used. Crosses instead of U-turns are created.
# 6: However, the region solver of Toolpath Regions is not compatible with self-intersectiong curves.
# 2: In Simplify/Merge Region, you can choose to snap the bridges/u-turns to the X or Y Axis.
# 1: Regions are the solid parts of a plane enclosed by toolpath curves. They can have holes.
# 3: You can change the threshold of Simplify/Merge Region.
number_slider_9 = Slider(2, range=0..10)
geo_2 = Geometry(brep)
slice_4 = Slice(Geometry=flatten(geo_2), Thickness=number_slider_9, joinCurves=True, useBoundingBed=False)
tpregions_2 = ToolpathRegions(Toolpath=slice_4)
X = UnitX(Factor=Slider(24, range=0..100))
movetp_2 = MoveToolpath(Toolpath=slice_4, Vector=X)  # -> Toolpath, Transform
panel = Panel(movetp_2.Toolpath)
simplifyregion = SimplifyRegion(Toolpath=movetp_2.Toolpath, alignType=2)
tpregions_3 = ToolpathRegions(Toolpath=simplifyregion)
movetp_3 = MoveToolpath(Toolpath=simplifyregion, Vector=X)  # -> Toolpath, Transform
mergeregions = MergeRegions(Toolpath=movetp_3.Toolpath, Threshold=Slider(5.8, range=0..10), alignType=0)
tpregions_4 = ToolpathRegions(Toolpath=mergeregions)
panel_2 = Panel(mergeregions)
geo_3 = Geometry([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])
slice_5 = Slice(Geometry=flatten(geo_3), Thickness=Slider(2, range=0..10), joinCurves=True, useBoundingBed=False)
neg = Negative(Value=Slider(3.6, range=0..10))
simplifyregion_2 = SimplifyRegion(Toolpath=slice_5, Distance=neg, alignType=2)
mergeregions_2 = MergeRegions(Toolpath=simplifyregion_2, Distance=neg, Threshold=Slider(5.8, range=0..10), alignType=0)
tpregions_5 = ToolpathRegions(Toolpath=mergeregions_2)

# ----
# 1 Slicing options
# 1: Orient the geometry using the bottom surface/plane. Also solve the relative top surface/plane
geo_4 = Geometry(brep)
bottom_srf = Surface(<surface referenced from the Rhino model>)  # disabled
top_srf = Surface(<surface referenced from the Rhino model>)  # disabled
orient_2 = Orient(Geometry=top_srf, Source=bottom_srf, Target=PlaneXY(0, 0, 0))  # -> Geometry, Transform; disabled
orient_3 = Orient(Geometry=geo_4, Source=bottom_srf, Target=PlaneXY(0, 0, 0))  # -> Geometry, Transform; disabled

# ----
# 2: Infill is generated by connecting parallel loops. This method is primitive and not always ideal.
# 1: A toolpath can be split using a layer index. The two parts can be modified individually and then joined back.
# 4: This is an example of generating printing animation. Right click this slider to animate.
number_slider_10 = Slider(0.7, range=0..1)  # disabled
brep_4 = Brep(brep)  # disabled
number_slider_11 = Slider(2, range=0..10)  # disabled
slice_6 = Slice(Geometry=flatten(brep_4), Thickness=number_slider_10, joinCurves=True, useBoundingBed=False)  # disabled
polylinetp_2 = PolylineToolpath(Toolpath=slice_6, polylineType=0)  # disabled
number_slider_12 = Slider(3, range=0..10)  # disabled
splitlayers = SplitLayers(Toolpath=polylinetp_2, Index=number_slider_11)  # -> ToolpathA, ToolpathB; disabled
tp = Toolpath(
    splitlayers.ToolpathA,
    customColor=RGB(0, 0, 0),
    onSlicingPlanes=False,
    paletteI=0,
    showDirections=False,
    showEnds=False,
    showPolylinePoints=False,
    toolpathDisplayMode=0,
    useSmooth=True)  # disabled
tp_2 = Toolpath(
    splitlayers.ToolpathB,
    customColor=RGB(0, 0, 0),
    onSlicingPlanes=False,
    paletteI=0,
    showDirections=False,
    showEnds=False,
    showPolylinePoints=False,
    toolpathDisplayMode=0,
    useSmooth=True)  # disabled
infill = Infill(Toolpath=tp, Distance=number_slider_12, bridgeMethod=1, smoothResult=False)  # disabled
joinlayers = JoinLayers(ToolpathA=infill, ToolpathB=tp_2)  # disabled

# ----
# 1: Right click any TP parameter and check "Show ends" to see the seam points of closed toolpath curves.
# 3: You can choose to snap them to the X axis or Y axis.
# 2: The location of these seam points, as a result of slicing, is a bit arbitrary.
# 6: You can also model closed breps/meshes that the seam points should avoid. You may also constrain the overhang of seam points. Depending on your geometry, the resulting seam points might be less consistent.
# 5: If you need more refined control of seam points, you can always unwrap Tooolpath, modify the curves and wrap back the Toolpath. Here is a simple example that aligns seams to a certain external point.
# 4: This will affect how the Continuous Toolpath is created.
number_slider_13 = Slider(1, range=0..10)
# 6 2/2 Layer-Level Optimizations
geo_5 = Geometry(brep)
slice_7 = Slice(Geometry=flatten(geo_5), Thickness=number_slider_13, joinCurves=True, useBoundingBed=False)
movetp_4 = MoveToolpath(Toolpath=slice_7, Vector=Vector(40, 0, 0))  # -> Toolpath, Transform
align_seams = AlignSeams(Toolpath=movetp_4.Toolpath, alignType=1, seamDirection=0)
movetp_5 = MoveToolpath(Toolpath=align_seams, Vector=Vector(0, 40, 0))  # -> Toolpath, Transform
continuousprinting = ContinuousPrinting(
    Toolpath=movetp_5.Toolpath,
    NozzleHeight=Slider(4, range=0..10),
    BufferIn=0,
    BufferOut=0,
    dependencyGraphType=2,
    onSlicingPlanes=False,
    paletteI=0,
    randomSeed=1,
    showCurve=True,
    showEnds=False,
    showGraph=True,
    showPolylinePoints=False,
    zoomFactor=1)
movetp_6 = MoveToolpath(Toolpath=movetp_4.Toolpath, Vector=Vector(40, 0, 0))  # -> Toolpath, Transform
align_seams_2 = AlignSeams(Toolpath=movetp_6.Toolpath, alignType=2, seamDirection=0)
movetp_7 = MoveToolpath(Toolpath=align_seams_2, Vector=Vector(0, 40, 0))  # -> Toolpath, Transform
continuousprinting_2 = ContinuousPrinting(
    Toolpath=movetp_7.Toolpath,
    NozzleHeight=Slider(4, range=0..10),
    BufferIn=0,
    BufferOut=0,
    dependencyGraphType=2,
    onSlicingPlanes=False,
    paletteI=0,
    randomSeed=1,
    showCurve=True,
    showEnds=False,
    showGraph=True,
    showPolylinePoints=False,
    zoomFactor=1)
movetp_8 = MoveToolpath(Toolpath=movetp_6.Toolpath, Vector=Vector(40, 0, 0))  # -> Toolpath, Transform
movetp_9 = MoveToolpath(Toolpath=movetp_8.Toolpath, Vector=Vector(40, 0, 0))  # -> Toolpath, Transform
geo_6 = Geometry(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)
align_seams_3 = AlignSeams(Toolpath=movetp_9.Toolpath, Overhang=Slider(0.4, range=0..1), AvoidGeometry=flatten(geo_6), alignType=2, seamDirection=0)

movetp_10 = MoveToolpath(Toolpath=slice_2, Vector=Vector(150, 0, 0))  # -> Toolpath, Transform
movetp_11 = MoveToolpath(Toolpath=movetp.Toolpath, Vector=Vector(150, 0, 0))  # -> Toolpath, Transform
movetp_12 = MoveToolpath(Toolpath=movetp_11.Toolpath, Vector=Vector(150, 0, 0))  # -> Toolpath, Transform
cleantp_3 = CleanToolpath(Toolpath=movetp_12.Toolpath, closeOpen=True, cullShort=True)  # -> Toolpath, Curves
cleantp_4 = CleanToolpath(Toolpath=movetp_11.Toolpath, closeOpen=True, cullShort=True)  # -> Toolpath, Curves
tptopology = ToolpathTopology(
    Toolpath=slice_2,
    onSlicingPlanes=False,
    paletteI=0,
    randomSeed=0,
    showCurve=True,
    showEnds=False,
    showGraph=False,
    showPolylinePoints=False,
    zoomFactor=1)
tptopology_2 = ToolpathTopology(
    Toolpath=movetp_10.Toolpath,
    onSlicingPlanes=False,
    paletteI=0,
    randomSeed=0,
    showCurve=False,
    showEnds=False,
    showGraph=True,
    showPolylinePoints=False,
    zoomFactor=1)
number_slider_14 = Slider(0.5, range=0..1)  # disabled

# ----
# 2: Use the relative top surface/plane to slice.
number_slider_15 = Slider(1, range=0..10)  # disabled
slice_8 = Slice(
    Geometry=flatten(orient_3.Geometry),
    Thickness=number_slider_14,
    TopPlane=orient_2.Geometry,
    joinCurves=True,
    useBoundingBed=False)  # disabled

continuousprinting_3 = ContinuousPrinting(
    Toolpath=cleantp_2.Toolpath,
    NozzleHeight=Slider(0, range=0..10),
    BufferIn=0,
    BufferOut=0,
    dependencyGraphType=2,
    onSlicingPlanes=False,
    paletteI=0,
    randomSeed=0,
    showCurve=True,
    showEnds=False,
    showGraph=False,
    showPolylinePoints=False,
    zoomFactor=1)
continuousprinting_4 = ContinuousPrinting(
    Toolpath=cleantp_4.Toolpath,
    NozzleHeight=Slider(5, range=0..10),
    BufferIn=0,
    BufferOut=0,
    dependencyGraphType=2,
    onSlicingPlanes=False,
    paletteI=0,
    randomSeed=0,
    showCurve=True,
    showEnds=False,
    showGraph=False,
    showPolylinePoints=False,
    zoomFactor=1)
continuousprinting_5 = ContinuousPrinting(
    Toolpath=cleantp_3.Toolpath,
    NozzleHeight=Slider(10, range=0..10),
    BufferIn=0,
    BufferOut=0,
    dependencyGraphType=2,
    onSlicingPlanes=False,
    paletteI=0,
    randomSeed=0,
    showCurve=True,
    showEnds=False,
    showGraph=False,
    showPolylinePoints=False,
    zoomFactor=1)
brep_5 = Brep([<brep referenced from the Rhino model> x42])
# 2: You can right click Toolpath Topology to turn on/off the curves and dependency graph. You may also customize the visualization styles.
# 4: You can bake the topology information as displayed.
_3 = Panel(tptopology_2)
panel_3 = Panel(slice)
# 2: Even if the nozzle height is zero, the number of toolpath curves is still reduced.
panel_4 = Panel(continuousprinting_3)
# 3: To avoid collision in complex geometries, you should also read the "Simplify and Merge Regions" example in "Toolpath Operations".
panel_5 = Panel(continuousprinting_4)
# half-edges
# half-faces
panel_6 = Panel(continuousprinting_5)
slice_9 = Slice(Geometry=flatten(brep_5), Thickness=Slider(0.7, range=0..1), joinCurves=True, useBoundingBed=False)
number_slider_16 = Slider(2.1, range=0..10)  # disabled

# ----
# 3: Visualize the print. Orient it back to show visualization in place.
number_slider_17 = Slider(2, range=0..10)  # disabled
inverse = InverseTransform(Transform=orient_3.Transform)  # disabled
visualizeprinting_2 = VisualizePrinting(Toolpath=slice_8, Width=number_slider_16, Sides=3, mergeEnds=True, useSegmentWidth=False)  # disabled
transform = Transform(Geometry=visualizeprinting_2, Transform=inverse)  # disabled

example_files = ExampleFiles()  # disabled
number_slider_18 = Slider(200, range=0..1000)
bedadhesion = BedAdhesion(Toolpath=slice_8, Number=1, Gap=0, seamDirection=0, smoothResult=True)
align_seams_4 = AlignSeams(Toolpath=bedadhesion, alignType=0, seamDirection=0)
cleantp_5 = CleanToolpath(Toolpath=align_seams_4, closeOpen=True, cullShort=True)  # -> Toolpath, Curves
printbed = PrintBed(X=number_slider_18, Y=number_slider_18)
continuousprinting_6 = ContinuousPrinting(
    Toolpath=cleantp_5.Toolpath,
    NozzleHeight=Slider(0, range=0..100),
    BufferIn=0,
    BufferOut=0,
    dependencyGraphType=2,
    onSlicingPlanes=False,
    paletteI=0,
    randomSeed=0,
    showCurve=True,
    showEnds=False,
    showGraph=True,
    showPolylinePoints=False,
    zoomFactor=1)
# 1: You may right click to select a preset gcode configuration. You can then add parameters that you wish to modify (for example, width here).
# 2: If you provide a path, you can click "save" to save the G-codes.
number_slider_19 = Slider(5, range=0..10)
orientctp = OrientContinuousToolpath(ContinuousToolpath=continuousprinting_6, BasePlane=printbed)  # -> ContinuousToolpath, Transform

unwraptp = UnwrapToolpath(Toolpath=movetp_8.Toolpath, usePolyline=False)  # -> Curves, Height, Tangent
tpplanes_2 = ToolpathPlanes(Toolpath=movetp_8.Toolpath)  # -> BasePlane, SlicePlanes, NozzlePlanes
pt = PointOriented(BasePlane=tpplanes_2.BasePlane, UComponent=Slider(-5, range=-5..5), VComponent=Slider(-5, range=-5..5), WComponent=0)
crv_cp = CurveClosestPoint(Point=pt, Curve=unwraptp.Curves)  # -> Point, Parameter, Distance
seam = Seam(Curve=unwraptp.Curves, Seam=crv_cp.Parameter)
wraptp = WrapToolpath(Curve=seam, sortGroups=True, useReference=0)

tp_3 = Toolpath(
    transform,
    customColor=RGB(0, 0, 0),
    onSlicingPlanes=False,
    paletteI=0,
    showDirections=False,
    showEnds=False,
    showPolylinePoints=False,
    toolpathDisplayMode=2,
    useSmooth=True)
gcode = GCode(Toolpath=tp_3, Path="C:\Yefan\test.gcode", Width=number_slider_19, presetI=0)  # -> GCodes, Time

# ----
# 3: This is an example of generating printing animation. Right click this slider to animate.
number_slider_20 = Slider(1, range=0..1)  # disabled

gcodecontinuous = GCodeContinuous(ContinuousToolpath=orientctp.ContinuousToolpath, Path="C:\Users\USER\Downloads\AAG 2025\test prapawit.gcode", presetI=1)  # -> GCodes, Time
gcodecontinuous_2 = GCodeContinuous(presetI=0)  # -> GCodes, Time
panel_7 = Panel(gcodecontinuous.GCodes)
panel_8 = Panel(gcodecontinuous.Time)
# 3: By exploding the gocde tree you get the current start/main/end codes.
bang = ExplodeTree(Data=panel_7)  # -> Branch0, Branch1, Branch2
examplefiles_4 = ExampleFiles()
start_codes = Text(bang.Branch0)
main_codes = Text(bang.Branch1)
end_codes = Text(bang.Branch2)
# 4: You can replace the start/end codes if you add these two parameters from right click.
panel_9 = Panel("; custom start codes")
gcode_2 = GCode(Toolpath=tp_3, StartCodes=panel_9, presetI=0)  # -> GCodes, Time
panel_10 = Panel(gcode_2.GCodes)

number_slider_21 = Slider(5, range=0..10)  # disabled
align_seams_5 = AlignSeams(Toolpath=joinlayers, alignType=3, seamDirection=7)  # disabled
polylinetp_3 = PolylineToolpath(Toolpath=align_seams_5, polylineType=0)  # disabled
number_slider_22 = Slider(0, range=0..100)  # disabled
smoothtp_2 = SmoothToolpath(Toolpath=polylinetp_3, Strength=number_slider_21, Times=100, side=0)  # disabled

cleantp_6 = CleanToolpath(Toolpath=smoothtp_2, closeOpen=True, cullShort=True)  # -> Toolpath, Curves; disabled

polylinetp_4 = PolylineToolpath(Toolpath=cleantp_6.Toolpath, polylineType=2)  # disabled

unwraptp_2 = UnwrapToolpath(Toolpath=polylinetp_4, usePolyline=False)  # -> Curves, Height, Tangent; disabled
panel_11 = Panel(unwraptp_2.Curves)  # disabled
splitlayers_2 = SplitLayers(Toolpath=polylinetp_4, Index=1)  # -> ToolpathA, ToolpathB; disabled

continuousprinting_7 = ContinuousPrinting(
    Toolpath=splitlayers_2.ToolpathB,
    NozzleHeight=number_slider_22,
    BufferIn=0,
    BufferOut=0,
    dependencyGraphType=2,
    onSlicingPlanes=False,
    paletteI=0,
    randomSeed=0,
    showCurve=True,
    showEnds=False,
    showGraph=False,
    showPolylinePoints=False,
    zoomFactor=1)  # disabled

number_slider_23 = Slider(300, range=0..1000)  # disabled
printbed_2 = PrintBed(X=number_slider_23, Y=number_slider_23)  # disabled
orientctp_2 = OrientContinuousToolpath(ContinuousToolpath=continuousprinting_7, BasePlane=printbed_2)  # -> ContinuousToolpath, Transform; disabled
panel_12 = Panel("C:/Yefan/Heart.gcode")  # disabled
gcodecontinuous_3 = GCodeContinuous(Path=panel_12, Width=number_slider_12, presetI=1)  # -> GCodes, Time; disabled
panel_13 = Panel(gcodecontinuous_3.Time)  # disabled

subctp = SubContinuousToolpath(ContinuousToolpath=orientctp_2.ContinuousToolpath, Parameter=number_slider_20)  # disabled
visualizecontinuousprinting = VisualizeContinuousPrinting(
    ContinuousToolpath=subctp,
    Width=number_slider_12,
    Sides=3,
    paletteI=0,
    randomSeed=0,
    toolpathDisplayMode=0,
    useSegmentWidth=False)  # disabled
bubblegumblue = BubbleGumBlue()  # disabled
preview_3 = CustomPreview(Geometry=visualizecontinuousprinting, Material=bubblegumblue)  # disabled

# ==== cluster BubbleGumBlue
col = Colour(RGB(167, 199, 206))
color = ClusterOutput(col)
